# Grasshopper definition slice_and_print.ghx (Grasshopper 1.0.7)

# ----
# Geometry
number_slider = Slider(200, range=0..1000)
resolution_length = Slider(4, range=0..10)
circle = Circle(Plane=PlaneXY(0, 0, 0), Radius=number_slider)
divlength = DivideLength(Curve=circle, Length=resolution_length)  # -> simplify(Points), Tangents, Parameters
xy = XYPlane(Origin=divlength.Points)
rotate = Rotate(Geometry=xy, Angle=degrees(Slider(0, range=0..1000)), Plane=xy)  # -> Geometry, Transform
rotate_2 = Rotate(Geometry=rotate.Geometry, Angle=degrees(Slider(180, range=0..1000)), Plane=rotate.Geometry)  # -> Geometry, Transform
flip_plane = FlipPlane(Plane=xy, ReverseX=False, ReverseY=False, SwapAxes=True)

# ----
# ABB client
boolean_toggle = BooleanToggle(True)
ros_connect = ROSConnect(connect=boolean_toggle)  # -> ros_client, is_connected; inputs port: Int32, connect: Boolean
#   port ip: The ip address ROS. Defaults to 127.0.0.1.
#   port port: The port of ROS. Defaults to 9090.
#   port connect: If True, connects to ROS. If False, disconnects from ROS. Defaults to False.
#   port ros_client: The ROS client.
#   port is_connected: True if connection established.
# ---------- ros_connect: Python ----------
"""
Connect or disconnect to ROS.

COMPAS FAB v0.28.0
"""
from ghpythonlib.componentbase import executingcomponent as component
from scriptcontext import sticky as st

from compas_fab.backends import RosClient
from compas_fab.ghpython.components import create_id


class ROSConnect(component):
    def RunScript(self, ip, port, connect):
        ros_client = None

        ip = ip or "127.0.0.1"
        port = port or 9090

        key = create_id(self, "ros_client")
        ros_client = st.get(key, None)

        if ros_client:
            st[key].close()
        if connect:
            st[key] = RosClient(ip, port)
            st[key].run(5)

        ros_client = st.get(key, None)
        is_connected = ros_client.is_connected if ros_client else False
        return (ros_client, is_connected)
# ---------- end ros_connect ----------
panel = Panel(ros_connect.is_connected)
ros = PythonScript(ros_client=ros_connect.ros_client)  # -> out, abb_client
# ---------- ros: Python ----------
import scriptcontext as sc

from compas_fab.backends import RosClient

from compas_rrc import AbbClient

if ros_client and ros_client.is_connected:
    abb_client = AbbClient(ros_client)
# ---------- end ros ----------

a1 = Slider(0, range=-360..360)
a2 = Slider(10, range=-360..360)
a3 = Slider(15, range=-360..360)
a4 = Slider(0, range=-360..360)
a5 = Slider(25, range=-360..360)
a6 = Slider(180, range=-360..360)
forward_kinematics = PythonScript(a1=a1, a2=a2, a3=a3, a4=a4, a5=a5, a6=a6)  # -> configuration
# ---------- forward_kinematics: Python ----------
from compas_rrc import RobotJoints

configuration = RobotJoints([a1, a2, a3, a4, a5, a6])
# ---------- end forward_kinematics ----------

list = ValueList({"MoveJ": True, "MoveL": False}, selected="MoveL")
python = GhPythonScript(
    client=ros.abb_client,
    planes=flip_plane,
    start_joint_pos=forward_kinematics,
    motion_type=list,
    tool_name="t_3dp_hemera_supervolcano",
    wobj_name="w_3dp",
    speed=Slider(50, range=0..250),
    run=Button(),
    dry_run=Toggle(True))  # -> a; inputs planes: tree of Plane, speed: Int32, run: Boolean
# ---------- python: Python ----------
from compas_ghpython.utilities import ghtree_to_list

from compas_rhino.conversions import plane_to_compas_frame

import compas_rrc as rrc

planes_list_of_lists = ghtree_to_list(planes)

ghenv.Component.Message = "Print planes"

#HEATER_DO = "DO_11"
EXTRUDE_BACKWARDS_DO = "DO_11"
EXTRUDE_FORWARD_DO = "DO_12"
TRAVEL_SPEED = 30

RETRACT_SECONDS = 1.0

if not start_joint_pos:
    start_joint_pos = rrc.RobotJoints([0, -30, 0, 0, 25, 130])

if not between_curves_joint_pos:
    between_curves_joint_pos = start_joint_pos

EXTERNAL_AXES = rrc.ExternalAxes()

if not tool_name:
    tool_name = "tool0"
if not wobj_name:
    wobj_name = "w_3dp"
if not speed:
    speed = 100

if not dry_run:
    dry_run = False

if motion_type == "MoveJ":
    motion = rrc.Motion.JOINT
elif motion_type == "MoveL":
    motion = rrc.Motion.LINEAR
else:
    motion = rrc.Motion.JOINT

if not client:
    raise Exception("No ABB client")

if not client.ros.is_connected:
    raise Exception("Not connected to ROS")

print("Ready to run")

if run:
    # reset digital signals
    client.send(rrc.SetDigital(EXTRUDE_FORWARD_DO, 0))
    client.send(rrc.SetDigital(EXTRUDE_BACKWARDS_DO, 0))
        
    client.send(rrc.SetTool(tool_name))
    client.send(rrc.SetWorkObject(wobj_name))
    client.send(rrc.SetAcceleration(100, 100))
    client.send(rrc.SetMaxSpeed(100, 150))
    
    client.send(rrc.MoveToJoints(start_joint_pos, EXTERNAL_AXES,  TRAVEL_SPEED, rrc.Zone.FINE))
    
    if not dry_run:
        #client.send(rrc.SetDigital(HEATER_DO, 1)) # started manually for now.
        
        client.send(rrc.PrintText("Press play when heater is at temperature."))
        client.send(rrc.Stop())

    for planes_list in planes_list_of_lists:

        frames = [plane_to_compas_frame(plane) for plane in planes_list]
        
        # first print point
        client.send(rrc.MoveToFrame(frames[0],
                                    TRAVEL_SPEED,
                                    rrc.Zone.FINE,
                                    rrc.Motion.JOINT))
    
        if not dry_run:
            client.send(rrc.SetDigital(EXTRUDE_FORWARD_DO, 1))
    
        for frame in frames[1:]:
            client.send(rrc.MoveToFrame(frame,
                                        speed,
                                        rrc.Zone.Z1,
                                        motion))
    
        if not dry_run:
            client.send(rrc.SetDigital(EXTRUDE_FORWARD_DO, 0))
            client.send(rrc.SetDigital(EXTRUDE_BACKWARDS_DO, 1))
            client.send(rrc.WaitTime(RETRACT_SECONDS))
            client.send(rrc.SetDigital(EXTRUDE_BACKWARDS_DO, 0))
    
        client.send(rrc.MoveToJoints(between_curves_joint_pos, EXTERNAL_AXES,  TRAVEL_SPEED, rrc.Zone.FINE))
    client.send(rrc.MoveToJoints(start_joint_pos, EXTERNAL_AXES,  TRAVEL_SPEED, rrc.Zone.FINE))
# ---------- end python ----------
python_2 = GhPythonScript(
    client=ros.abb_client,
    sec_to_run=Slider(30, range=0..30),
    send_extrusion=Button(),
    send_retraction=Button(),
    send_stop=Button())  # -> out; inputs sec_to_run: tree, send_extrusion: Boolean
# ---------- python_2: Python ----------
import compas_rrc as rrc

ghenv.Component.Message = "Run extruder stepper"


BACKWARDS_DO = "DO_11"
FORWARDS_DO = "DO_12"

if not client:
    raise Exception("No ABB client")

if not client.ros.is_connected:
    raise Exception("Not connected to ROS")

print("Ready to run")

def stop_all():
    client.send(rrc.SetDigital(FORWARDS_DO, 0))
    client.send(rrc.SetDigital(BACKWARDS_DO, 0))

if send_extrusion:
    stop_all()
    client.send(rrc.SetDigital(FORWARDS_DO, 1))
    client.send(rrc.WaitTime(sec_to_run))
    stop_all()

if send_retraction:
    stop_all()
    client.send(rrc.SetDigital(BACKWARDS_DO, 1))
    client.send(rrc.WaitTime(sec_to_run))
    stop_all()

if send_stop:
    stop_all()
# ---------- end python_2 ----------
python_3 = GhPythonScript(client=ros.abb_client, start_joint_pos=forward_kinematics, speed=Slider(100, range=0..250), run=Button())  # -> out; inputs speed: Int32, run: Boolean
# ---------- python_3: Python ----------
import compas_rrc as rrc

ghenv.Component.Message = "Move to joint position"
EXTERNAL_AXES = rrc.ExternalAxes()

if not start_joint_pos:
    start_joint_pos = rrc.RobotJoints([0, 0, 0, 0, 0, 0])

if not speed:
    speed = 100

if not client:
    raise Exception("No ABB client")

if not client.ros.is_connected:
    raise Exception("Not connected to ROS")

print("Ready to run")

if run:
    client.send(rrc.MoveToJoints(start_joint_pos, EXTERNAL_AXES,  speed, rrc.Zone.FINE))
# ---------- end python_3 ----------
panel_2 = Panel(python)
