# Grasshopper definition planes_to_3dp_rapid_program.ghx (Grasshopper 1.0.7)

# Is travel point
boolean = Boolean([True, False, False, False, False, True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])
# Points
point = Point([Point(0, 0, 0), Point(200, 100, 10), Point(200, 1100, 10), Point(600, 1100, 10), Point(600, 100, 10), Point(200, 100, 10)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])
value_list = ValueList({"v5", "v10", "v20", "v30", "v40", "v50", "v60", "v80", "v100", "v150", "v200", "v300", "v400", "v500", "v600", "v800", "v1000", "v1500", "v2000", "v2500", "v3000", "v4000", "v5000", "v6000", "v7000", "vmax"}, selected="v5")
merge = Merge(
    Data1=Slider(0, range=-360..360),
    Data2=Slider(0, range=-360..360),
    Data3=Slider(0, range=-360..360),
    Data4=Slider(0, range=-360..360),
    Data5=Slider(0, range=-360..360),
    Data6=Slider(0, range=-360..360))
construct_plane = ConstructPlane(Origin=point, XAxis=Vector(1, 0, 0), YAxis=Vector(0, 1, 0))
flip_plane = FlipPlane(Plane=construct_plane, ReverseX=False, ReverseY=False, SwapAxes=True)
ghpython_script = GhPythonScript(
    planes=flip_plane,
    is_travel_point=boolean,
    start_configuration=merge,
    wobj_name="ob_RRC_workplace",
    print_speed_value=value_list)  # -> out, rapid; inputs planes: list, is_travel_point: list, start_configuration: list
# ---------- ghpython_script: Python ----------
import Rhino.Geometry as rg

EXT_AXES = "[9E9,9E9,9E9,9E9,9E9,9E9]"

def rg_plane_to_posdata(plane):
    x, y, z = plane.Origin
    
    posdata = "[[{:.1f}, {:.1f}, {:.1f}],".format(x, y, z)
    
    q = rg.Quaternion.Rotation(rg.Plane.WorldXY, plane)
    
    posdata += "[{:.4f}, {:.4f}, {:.4f}, {:.4f}],".format(q.A, q.B, q.C, q.D)
    posdata += "[0,0,0,0],{}]".format(EXT_AXES)
    
    return posdata

if wobj_name is None:
    wobj_name = "wobj0"
if tool_name is None:
    tool_name = "tool0"

if start_configuration is None:
    start_configuration = [0, 0, 0, 0, 0, 0]

heater_on = "DO_1"
stepper_on = "DO_10"

if print_speed_value is None:
    print_speed_value = "s_printSpeed"

TRAVEL_SPEED_VALUE = "v300"

PRINT_SPEED_NAME = "s_printSpeed"
TRAVEL_SPEED_NAME = "s_travelSpeed"

module_level_vars = """VAR speeddata {}:={};
    VAR speeddata {}:={};
""".format(PRINT_SPEED_NAME, print_speed_value, TRAVEL_SPEED_NAME, TRAVEL_SPEED_VALUE)


main_proc = """PROC main()
        IF RobOS() = FALSE THEN
            {} := vmax; ! run at max speed in robotstudio
            {} := vmax;
        ENDIF
        print;
    ENDPROC
""".format(TRAVEL_SPEED_NAME, PRINT_SPEED_NAME)

extrude10sec_proc = """PROC Extrude10Sec ()
        SetDO {}, 1;
        SetDO\SDelay:=10, {}, 0;
    ENDPROC
""".format(stepper_on, stepper_on)
home_joint_pos = "[" + ",".join([str(c) for c in start_configuration]) + "]"

move_abs_j_start = "MoveAbsJ [{}, {}], {}, fine, tool0;".format(home_joint_pos,EXT_AXES,TRAVEL_SPEED_NAME)
move_j_start = "MoveJ {}, {}, fine, {}, \WObj:={};".format(rg_plane_to_posdata(planes[0]), 
                                                           TRAVEL_SPEED_NAME, 
                                                           tool_name, 
                                                           wobj_name)
rapid = """MODULE fdm_print
    {}
    {}
    {}
    PROC print()
        {}
        SetDO {}, 1; ! heater on
        TPWrite "Press play when extruder is at right temperature";
        Stop;
        {}
""".format(module_level_vars, 
           extrude10sec_proc, 
           main_proc, 
           move_abs_j_start, 
           heater_on,
           move_j_start)

last_is_travel_pt = True
for plane, tp in zip(planes, is_travel_point):
    new_lines = ""
    if tp:
        if not last_is_travel_pt:
            new_lines = "        SetDO {}, 0; ! stepper on\n".format(stepper_on)
        speed = TRAVEL_SPEED_NAME
    else:
        if last_is_travel_pt:
            new_lines = "        SetDO {}, 1; ! stepper off\n".format(stepper_on)
        speed = PRINT_SPEED_NAME
    posdata = rg_plane_to_posdata(plane)
    new_lines += "        MoveL {}, {}, fine, {}, \WObj:={};".format(posdata, speed, tool_name, wobj_name)

    rapid += new_lines + "\n"
    last_is_travel_pt = tp

rapid += """        SetDO {}, 0; ! stepper off
        SetDO {}, 0; ! heater off
    ENDPROC
ENDMODULE""".format(stepper_on, heater_on)
# ---------- end ghpython_script ----------
file_path = FilePath("C:\Users\tetov\Downloads\fdm_print.mod")
ghpython_script_2 = GhPythonScript(contents=ghpython_script.rapid, filepath=file_path, save=Button())  # -> out, a
# ---------- ghpython_script_2: Python ----------
if save:
    with open(filepath, mode="w") as fp:
        fp.write(contents)
# ---------- end ghpython_script_2 ----------
panel = Panel(ghpython_script.rapid)
