# Grasshopper definition planes_to_3dp_rapid_program.ghx (Grasshopper 1.0.8)

# Is travel point
boolean = Boolean([True, False, False, False, False, True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])
# Points
point = Point([Point(0, 0, 0), Point(200, 100, 10), Point(200, 1100, 10), Point(600, 1100, 10), Point(600, 100, 10), Point(200, 100, 10)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])
construct_plane = ConstructPlane(Origin=point, XAxis=Vector(1, 0, 0), YAxis=Vector(0, 1, 0))
flip_plane = FlipPlane(Plane=construct_plane, ReverseX=False, ReverseY=False, SwapAxes=True)
ghpython_script = GhPythonScript(planes=flip_plane, is_travel_point=boolean)  # -> out, a; inputs planes: list, is_travel_point: list
# ---------- ghpython_script: Python ----------
import Rhino.Geometry as rg

rapid = """MODULE plot
    PROC main()
        print()
    ENDPROC
    PROC print()
"""
last_is_travel_pt = True
for plane, tp in zip(planes, is_travel_point):
    if not tp and tp != last_is_travel_pt:
        #TODO: Add set DO
        pass
    new_line = "    MoveL [["

    x, y, z = plane.Origin
    new_line = new_line + "{:.3f}, {:.3f}, {:.3f}".format(x, y, z)

    new_line += "],["
    q = rg.Quaternion.Rotation(rg.Plane.WorldXY, plane)
    
    new_line += "{:.3f}, {:.3f}, {:.3f}, {:.3f}".format(q.A, q.B, q.C, q.D)
    new_line += "],[0,0,0,0],[9E9,9E9,9E9,9E9,9E9,9E9]],[100.000,180.000,0.000,0.000],fine,t_pen \WObj:=w_table;"
    rapid += "    " + new_line + "\n"

rapid += "ENDPROC\nENDMODULE"

print(rapid)
# ---------- end ghpython_script ----------
panel = Panel(ghpython_script.out)
