# Grasshopper definition planes_to_3dp_rapid_program.ghx (Grasshopper 1.0.7)

# ---- group: Directly from points
point = Point(Tree({0}: [Point(0, 0, 0), Point(200, 100, 10), Point(200, 1100, 10), Point(600, 1100, 10), Point(600, 100, 10), Point(200, 100, 10), Point(260, 160, 10), Point(279, 179, 10), Point(279, 1021, 10), Point(521, 1021, 10), Point(521, 179, 10), Point(298, 179, 10), Point(279, 160, 10), Point(540, 160, 10), Point(540, 1040, 10), Point(260, 1040, 10), Point(260, 160, 10)], {1}: [Point(260, 160, 20), Point(279, 179, 20), Point(279, 1021, 20), Point(521, 1021, 20), Point(521, 179, 20), Point(298, 179, 20), Point(279, 160, 20), Point(540, 160, 20), Point(540, 1040, 20), Point(260, 1040, 20), Point(260, 160, 20)], {2}: [Point(260, 160, 30), Point(279, 179, 30), Point(279, 1021, 30), Point(521, 1021, 30), Point(521, 179, 30), Point(298, 179, 30), Point(279, 160, 30), Point(540, 160, 30), Point(540, 1040, 30), Point(260, 1040, 30), Point(260, 160, 30)], {3}: [Point(260, 160, 40), Point(279, 179, 40), Point(279, 1021, 40), Point(521, 1021, 40), Point(521, 179, 40), Point(298, 179, 40), Point(279, 160, 40), Point(540, 160, 40), Point(540, 1040, 40), Point(260, 1040, 40), Point(260, 160, 40)], {4}: [Point(260, 160, 50), Point(279, 179, 50), Point(279, 1021, 50), Point(521, 1021, 50), Point(521, 179, 50), Point(298, 179, 50), Point(279, 160, 50), Point(540, 160, 50), Point(540, 1040, 50), Point(260, 1040, 50), Point(260, 160, 50)], {5}: [Point(260, 160, 60), Point(279, 179, 60), Point(279, 1021, 60), Point(521, 1021, 60), Point(521, 179, 60), Point(298, 179, 60), Point(279, 160, 60), Point(540, 160, 60), Point(540, 1040, 60), Point(260, 1040, 60), Point(260, 160, 60)]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))

# ----
curve = Curve([<curve referenced from the Rhino model> x4])

# ----
# From curve, divide
number_slider = Slider(10, range=0..10)
divide_distance = DivideDistance(Curve=curve, Distance=number_slider)  # -> Points, Tangents, Parameters

# ----
# From curve, discontinuity
discontinuity = Discontinuity(Curve=curve, Level=1)  # -> Points, Parameters

# ----
# Planes by layer
construct_plane = ConstructPlane(Origin=discontinuity.Points, XAxis=Vector(1, 0, 0), YAxis=Vector(0, 1, 0))

# ----
# Adjust Z height
number_slider_2 = Slider(0, range=-10..0)
unit_z = UnitZ(Factor=number_slider_2)
move = Move(Geometry=construct_plane, Motion=unit_z)  # -> Geometry, Transform

merge = Merge(
    Data1=Slider(0, range=-360..360),
    Data2=Slider(0, range=-360..360),
    Data3=Slider(0, range=-360..360),
    Data4=Slider(0, range=-360..360),
    Data5=Slider(0, range=-360..360),
    Data6=Slider(180, range=-360..360))
flip_plane = FlipPlane(Plane=move.Geometry, ReverseX=False, ReverseY=False, SwapAxes=True)  # -> simplify(Plane)
list_length = ListLength(List=flip_plane)
repeat_data = RepeatData(Data=Toggle(False), Length=list_length)  # -> simplify(Data)

# ----
# Set first n points to travel
number_slider_3 = Slider(2, range=0..10)
ghpython_script = GhPythonScript(x=repeat_data, first_n=number_slider_3)  # -> out, simplify(layers); inputs x: tree
# ---------- ghpython_script: Python ----------
from ghpythonlib.treehelpers import tree_to_list, list_to_tree

layers = tree_to_list(x, retrieve_base=False)

# first point in every layer is travel point

for idx in range(int(first_n)):
    layers[0][idx] = True

layers = list_to_tree(layers, source=[])
# ---------- end ghpython_script ----------

# ----
# Set first point in layer to travel
ghpython_script_2 = GhPythonScript(x=repeat_data)  # -> out, simplify(layers); inputs x: tree
# ---------- ghpython_script_2: Python ----------
from ghpythonlib.treehelpers import tree_to_list, list_to_tree

layers = tree_to_list(x, retrieve_base=False)

for layer_idx in range(len(layers)):
    layers[layer_idx][0] = True

layers = list_to_tree(layers, source=[])
# ---------- end ghpython_script_2 ----------

panel = Panel(ghpython_script_2.layers)
abb_speeddata = ValueList({"v5", "v10", "v20", "v30", "v40", "v50", "v60", "v80", "v100", "v150", "v200", "v300", "v400", "v500", "v600", "v800", "v1000", "v1500", "v2000", "v2500", "v3000", "v4000", "v5000", "v6000", "v7000", "vmax"}, selected="v5")
abb_speeddata_2 = ValueList({"v5", "v10", "v20", "v30", "v40", "v50", "v60", "v80", "v100", "v150", "v200", "v300", "v400", "v500", "v600", "v800", "v1000", "v1500", "v2000", "v2500", "v3000", "v4000", "v5000", "v6000", "v7000", "vmax"}, selected="v100")
abb_zonedata = ValueList({"fine", "z1", "z5", "z10", "z15", "z20", "z30", "z40", "z50", "z60", "z80", "z100", "z150", "z200"}, selected="z1")
ghpython_script_3 = GhPythonScript(
    planes=simplify(flip_plane),
    is_travel_point=simplify(ghpython_script_2.layers),
    start_configuration=merge,
    tool_name="t_3dp_msdd",
    wobj_name="wob_3dp_msdd",
    print_speed_value=abb_speeddata,
    travel_speed_value=abb_speeddata_2,
    print_zone=abb_zonedata,
    retract=Toggle(False),
    z_hop=Slider(10, range=0..10))  # -> out, rapid; inputs planes: tree, is_travel_point: tree, start_configuration: list, retract: Boolean
# ---------- ghpython_script_3: Python ----------
import Rhino.Geometry as rg

from ghpythonlib.treehelpers import tree_to_list


EXT_AXES = "[9E9,9E9,9E9,9E9,9E9,9E9]"

def rg_plane_to_posdata(plane):
    x, y, z = plane.Origin
    
    posdata = "[[{:.1f}, {:.1f}, {:.1f}],".format(x, y, z)
    
    q = rg.Quaternion.Rotation(rg.Plane.WorldXY, plane)
    
    posdata += "[{:.4f}, {:.4f}, {:.4f}, {:.4f}],".format(q.A, q.B, q.C, q.D)
    posdata += "[0,0,0,0],{}]".format(EXT_AXES)
    
    return posdata

def get_move_instruction(plane, move_type, speed, zone, tool, wobj, prefix="        "):
    posdata = rg_plane_to_posdata(plane)
    return "{}{} {}, {}, {}, {}, \WObj:={};\n".format(prefix, move_type, posdata, speed, zone, tool, wobj)

if wobj_name is None:
    wobj_name = "wobj0"
if tool_name is None:
    tool_name = "tool0"

if retract is None:
    retract = False

if start_configuration is None:
    start_configuration = [0, 0, 0, 0, 0, 0]

heater_on = "DO_10"
stepper_fw = "DO_11"
stepper_bw = "DO_12"

PRINT_SPEED_NAME = "s_printSpeed"
TRAVEL_SPEED_NAME = "s_travelSpeed"

module_level_vars = """VAR speeddata {}:={};
    VAR speeddata {}:={};
""".format(PRINT_SPEED_NAME, print_speed_value, TRAVEL_SPEED_NAME, travel_speed_value)


main_proc = """PROC main()
        IF RobOS() = FALSE THEN
            {} := vmax; ! run at max speed in robotstudio
            {} := vmax;
        ENDIF
        print;
    ENDPROC
""".format(TRAVEL_SPEED_NAME, PRINT_SPEED_NAME)

extrude10sec_proc = """PROC Extrude10Sec ()
        SetDO {}, 1;
        SetDO\SDelay:=10, {}, 0;
    ENDPROC
""".format(stepper_fw, stepper_fw)

home_joint_pos = "[" + ",".join([str(c) for c in start_configuration]) + "]"

layers = tree_to_list(planes, retrieve_base=None)
is_travel_point_layers = tree_to_list(is_travel_point, retrieve_base=None)

move_abs_j_start = "MoveAbsJ [{}, {}], {}, fine, tool0;".format(home_joint_pos,EXT_AXES,TRAVEL_SPEED_NAME)

rapid = """MODULE fdm_print
    {}
    {}
    {}
    PROC print()
        {}
        IF RobOS() = TRUE THEN
            SetDO {}, 1; ! heater on
            TPWrite "Press play when extruder is at right temperature";
            Stop;
        ENDIF
        ! First layer
""".format(module_level_vars, 
           extrude10sec_proc, 
           main_proc, 
           move_abs_j_start, 
           heater_on)

last_tp = True
last_plane = None
for layer, is_travel_point_layer in zip(layers, is_travel_point_layers):
    for plane, tp in zip(layer, is_travel_point_layer):
        if tp:
            move_type = "MoveJ"
            zone = "fine"
            speed = TRAVEL_SPEED_NAME
            if not last_tp: # leaving print line
                rapid += "        SetDO {}, 0; ! stepper off\n".format(stepper_fw)
                if last_plane:
                    last_plane.Translate(rg.Vector3d(0, 0, z_hop or 10))
                    rapid += get_move_instruction(last_plane, move_type, speed, zone, tool_name, wobj_name)
                plane_above = plane.Clone() # clone to not affect plane used later
                plane_above.Translate(rg.Vector3d(0, 0, z_hop or 10))
                posdata = rg_plane_to_posdata(plane_above)
                rapid += get_move_instruction(plane_above, move_type, speed, zone, tool_name, wobj_name)
                
                if retract:
                    rapid += "        SetDO {}, 1; ! stepper backwards\n".format(stepper_bw)
                    rapid += "        WaitTime {};\n".format(retraction_time)
                    rapid += "        SetDO {}, 0; ! stop stepper backwards\n".format(stepper_bw)

        else:
            move_type = "MoveL"
            zone = print_zone
            speed = PRINT_SPEED_NAME
            if last_tp:
                rapid += "        SetDO {}, 1; ! stepper forward\n".format(stepper_fw)

        rapid += get_move_instruction(plane, move_type, speed, zone, tool_name, wobj_name)
        last_tp = tp
        last_plane = plane
    rapid += "        ! end layer \n"

rapid += """        SetDO {}, 0; ! stepper fw off
        SetDO {}, 0; ! stepper bw off
        SetDO {}, 0; ! heater off
    ENDPROC
ENDMODULE""".format(stepper_fw, stepper_bw, heater_on)
# ---------- end ghpython_script_3 ----------

# ----
# Save program and mod file
button = Button()
file_path = FilePath("C:\Users\tetov\Downloads\test.txt2")
ghpython_script_4 = GhPythonScript(rapid_program=ghpython_script_3.rapid, filepath=file_path, save=button)  # -> out
# ---------- ghpython_script_4: Python ----------
import os.path

basepath, extension = os.path.splitext(filepath)

mod_path = basepath + ".mod"
pgf_path = basepath + ".pgf"

pgf_text = """<?xml version="1.0" encoding="ISO-8859-1" ?>
<Program>
    <Module>{}</Module>
</Program>
""".format(os.path.basename(mod_path))

if save:
    with open(mod_path, mode="w") as fp:
        fp.write(rapid_program)
    with open(pgf_path, mode="w") as fp:
        fp.write(pgf_text)
# ---------- end ghpython_script_4 ----------

# ----
# Visualization
# 
# Doesn't show Z hop!
ghpython_script_5 = GhPythonScript(planes=simplify(flip_plane), is_travel=ghpython_script_2.layers)  # -> out, print_lines, travel_lines; inputs planes: tree, is_travel: tree
# ---------- ghpython_script_5: Python ----------
import Rhino.Geometry as rg

from ghpythonlib.treehelpers import list_to_tree, tree_to_list

plane_layers = tree_to_list(planes,retrieve_base=None)
tp_layers = tree_to_list(is_travel,retrieve_base=None)


last_pt = rg.Point3d(0,0,0)

print_lines = []
travel_lines = []

for layer, tp_layer in zip(plane_layers, tp_layers):
    for plane, tp in zip(layer, tp_layer):
        segment = rg.Line(last_pt, plane.Origin)
        if tp:
            travel_lines.append(segment)
        else:
            print_lines.append(segment)
        last_pt = plane.Origin
# ---------- end ghpython_script_5 ----------
custom_preview = CustomPreview(Geometry=ghpython_script_5.travel_lines, Material=ColourSwatch(SwatchColor=RGB(162, 255, 0)))
custom_preview_2 = CustomPreview(Geometry=ghpython_script_5.print_lines, Material=ColourSwatch(SwatchColor=RGB(0, 212, 255)))

panel_2 = Panel(ghpython_script_3.rapid)
